# Grasshopper definition joints_H+C.gh (Grasshopper 1.0.7)
# 3d joints generation from cluster and Hops

jointsize = Slider(6, range=0..100)
jointradius = Slider(1, range=1..15)
endoffset = Slider(0, range=0..10)
structsize = Slider(1, range=0..10)
caps = Slider(0, range=0..2)
frames = GetGeometry(AtLeast=1, AtMost=100, DeleteInput=False, Filter=1073741828, TreeAccess=False)
jointsize_2 = GetNumber(jointsize, AtLeast=1, AtMost=1, Maximum=1.797693135e+308, Minimum=1, TreeAccess=False)
jointradius_2 = GetNumber(jointradius, AtLeast=1, AtMost=1, Maximum=1.797693135e+308, Minimum=-1.797693135e+308, TreeAccess=False)
endoffset_2 = GetNumber(endoffset, {"0"}, selected=[], AtLeast=0, AtMost=1, Maximum=1.797693135e+308, Minimum=0, TreeAccess=False)
structsize_2 = GetNumber(structsize, {"1"}, selected=[], AtLeast=1, AtMost=1, Maximum=1.797693135e+308, Minimum=1, TreeAccess=False)
kinkangle = GetNumber(Slider(0, range=0..1), {"0"}, selected=[], AtLeast=0, AtMost=1, Maximum=1.797693135e+308, Minimum=0, TreeAccess=False)
caps_2 = GetNumber(caps, {"0"}, selected=[], AtLeast=0, AtMost=1, Maximum=2, Minimum=0, TreeAccess=False)
clusterjoints = ClusterJoints(
    frame=frames,
    jointsize=jointsize_2,
    jointradius=jointradius_2,
    endoffset=endoffset_2,
    structsize=structsize_2,
    kinkangle=kinkangle,
    caps=caps_2)  # -> joints, points, structs
context_bake = ContextBake(Geometry=clusterjoints.points)
context_bake_2 = ContextBake(Geometry=clusterjoints.structs)
context_bake_3 = ContextBake(Geometry=clusterjoints.joints)

# ==== cluster ClusterJoints
frame = ClusterInput()  # frame
jointsize = ClusterInput()  # jointSize
jointradius = ClusterInput()  # jointRadius
endoffset = ClusterInput()  # endOffset
structsize = ClusterInput()  # structSize
kinkangle = ClusterInput()  # kinkAngle
caps = ClusterInput()  # caps
shint = ShatterInt(crv=frame)  # -> flatten(S)
explode = Explode(Curve=shint, Recursive=True)  # -> flatten(Segments), Vertices
c_script = CSharpScript(
    lines=explode.Segments,
    jointSize=jointsize,
    Reference="C:\PROGRAM FILES\RHINO 7\PLUG-INS\GRASSHOPPER\COMPONENTS\Kangaroo2Component.gha")  # -> out, Joints, Structs, JointPts; inputs lines: list of Line, jointSize: Double
# ---------- c_script: C# usings ----------
using Kangaroo2Component.UtilityComponents;
# ---------- c_script: C# ----------
    MultiPipeMethods.HalfEdgeGraph skeleton = new MultiPipeMethods.HalfEdgeGraph();
    foreach (Line L in lines)
    {
      skeleton.AddEdge(L, 0.001);
    }

    List<Line> nodeLines = new List<Line>();
    List<Line> strutLines = new List<Line>();
    List<Point3d> nodes = new List<Point3d>(); // new list of points to store joint nodes
    for (int ni = 0; ni < skeleton.Nodes.Count; ni++)
    {
      List<Line> L = new List<Line>();
      MultiPipeMethods.Node n = skeleton.Nodes[ni];
      List<Point3d> pts = n.GetNeighbourPositions();
      for (int i = 0; i < pts.Count; i++)
      {
        Vector3d v = pts[i] - n.Position;
        v.Unitize();
        nodeLines.Add(new Line(n.Position, v * jointSize));
      }
      nodes.Add(n.Position); // add the position of the current node to the new list of points
    }

    for(int ei = 0;ei < skeleton.HalfEdges.Count;ei += 2)
    {
      Line L = skeleton.HalfEdges[ei].GetLine();
      Vector3d v = skeleton.HalfEdges[ei].GetDirection(true);
      v *= jointSize;
      Line segment = new Line(L.From + v, L.To - v);
      strutLines.Add(segment);
    }

    Joints = nodeLines;
    Structs = strutLines;
    JointPts = nodes; // set the output to the new list of points
# ---------- c_script: C# additional code ----------
  /// <summary>
  /// This method will be called once every solution, before any calls to RunScript.
  /// </summary>
  public override void BeforeRunScript()
  { }
  /// <summary>
  /// This method will be called once every solution, after any calls to RunScript.
  /// </summary>
  public override void AfterRunScript()
  { }
# ---------- end c_script ----------
short = ShortestList(ListA=c_script.JointPts, ListB=jointradius, TrimMode=2)  # -> ListA, ListB
mp = MultiPipe(
    Curves=c_script.Joints,
    NodeSize=short.ListB,
    SizePoints=short.ListA,
    EndOffset=endoffset,
    StrutSize=structsize,
    Segment=0,
    KinkAngle=kinkangle,
    CubeFit=0,
    Caps=caps)
mesh = Mesh(mp)
crv = Curve(c_script.Structs)
cluster = Cluster(M=mesh)
cluster_2 = Cluster(M=cluster)
disjoint = DisjointMesh(Mesh=cluster_2)
points = ClusterOutput(c_script.JointPts)  # points
joints = ClusterOutput(disjoint)  # joints
structs = ClusterOutput(crv)  # structs

# ==== cluster ShatterInt: Shatter multiple curves at their intersections
crv = ClusterInput()

crv_2 = Curve(reparameterize(flatten(crv)))
cx = CurveSelf(Curve=crv_2)  # -> Points, Params
shatter = Shatter(Curve=graft(crv_2), Parameters=cx.Params)
combine = CombineData(Input0=shatter, Input1=graft(crv_2))  # -> flatten(Result), Index

mcx = MultipleCurves(Curves=combine.Result)  # -> Points, IndexA, IndexB, ParamA, ParamB
cset = CreateSet(List=[mcx.IndexA, mcx.IndexB])  # -> Set, Map
lng = ListLength(List=combine.Result)
lng_2 = ListLength(List=[mcx.IndexA, mcx.IndexB])
series = Series(Start=0, Step=1, Count=lng)
series_2 = Series(Start=0, Step=1, Count=lng_2)
int = Integer(series)
path = CreatePath(Indices=graft(series_2))  # -> flatten(Branch)
exdiff = SetDifferenceS(SetA=cset.Set, SetB=int)
replace = ReplaceBranches(Data=simplify(graft([mcx.ParamA, mcx.ParamB])), Search=path, Replace=[mcx.IndexA, mcx.IndexB])
cull_i = CullIndex(List=combine.Result, Indices=exdiff, Wrap=False)
shatter_2 = Shatter(Curve=simplify(graft(cull_i)), Parameters=replace)

S = ClusterOutput(shatter_2)

# ==== cluster Cluster
M = ClusterInput()

wbcatmullclark = WeaverbirdsCatmullClarkSubdivision(MeshCurves=M, Level=1, SmoothNakedEdges=1)
demesh = DeconstructMesh(Mesh=wbcatmullclark)  # -> Vertices, Faces, Colours, Normals
wbnaked = WeaverbirdsNakedBoundary(MeshClosedPolylines=wbcatmullclark)
disc = Discontinuity(Curve=wbnaked, Level=1)  # -> Points, Parameters
fcircle = CircleFit(Points=disc.Points)  # -> Circle, Radius, Deviation
crv_cp = CurveClosestPoint(Point=disc.Points, Curve=fcircle.Circle)  # -> flatten(Point), Parameter, Distance
cp = ClosestPoint(Point=crv_cp.Point, Cloud=demesh.Vertices)  # -> ClosestPoint, CPIndex, Distance
replace = ReplaceItems(List=demesh.Vertices, Item=crv_cp.Point, Indices=cp.CPIndex, Wrap=False)
conmesh = ConstructMesh(Vertices=replace, Faces=demesh.Faces)

M_2 = ClusterOutput(conmesh)
