# Grasshopper definition joints.gh (Grasshopper 1.0.7)
# plug-ins: Kangaroo2 Components, ShapeDiverForGrasshopper
# joints generations

sddp = ShapeDiverDocumentPayload({AbsoluteTolerance=0, AngleTolerance=0, DistanceDisplayPrecision=0, GltfVersion="Gltf2", GrasshopperVersion="1.0.0007", InputGroups="{}", OutputGroups="{}", RelativeTolerance=0, RhinoVersion="7.29.23107.3001", UnitSystem=0, VersionCreated="1.14.0.0", VersionSaved="1.14.0.0"})
crv = Curve([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])
jointsize = Slider(6, range=0..100)
jointradius = Slider(1.6, range=1..15)
endoffset = Slider(0, range=0..10)
structsize = Slider(1, range=0..10)
caps = Slider(1, range=0..2)
frames = GetGeometry(crv, AtLeast=1, AtMost=100, DeleteInput=False, Filter=1073741828, TreeAccess=False)
shint = ShatterInt(crv=frames)  # -> flatten(S)
jointsize_2 = GetNumber(jointsize, AtLeast=1, AtMost=1, Maximum=1.797693135e+308, Minimum=1, TreeAccess=False)
jointradius_2 = GetNumber(jointradius, AtLeast=1, AtMost=1, Maximum=1.797693135e+308, Minimum=-1.797693135e+308, TreeAccess=False)
explode = Explode(Curve=shint, Recursive=True)  # -> flatten(Segments), Vertices
c_script = CSharpScript(
    lines=explode.Segments,
    jointSize=jointsize_2,
    Reference="C:\PROGRAM FILES\RHINO 7\PLUG-INS\GRASSHOPPER\COMPONENTS\Kangaroo2Component.gha")  # -> out, Joints, Structs, JointPts; inputs lines: list of Line, jointSize: Double
# ---------- c_script: C# usings ----------
using Kangaroo2Component.UtilityComponents;
# ---------- c_script: C# ----------
    MultiPipeMethods.HalfEdgeGraph skeleton = new MultiPipeMethods.HalfEdgeGraph();
    foreach (Line L in lines)
    {
      skeleton.AddEdge(L, 0.001);
    }

    List<Line> nodeLines = new List<Line>();
    List<Line> strutLines = new List<Line>();
    List<Point3d> nodes = new List<Point3d>(); // new list of points to store joint nodes
    for (int ni = 0; ni < skeleton.Nodes.Count; ni++)
    {
      List<Line> L = new List<Line>();
      MultiPipeMethods.Node n = skeleton.Nodes[ni];
      List<Point3d> pts = n.GetNeighbourPositions();
      for (int i = 0; i < pts.Count; i++)
      {
        Vector3d v = pts[i] - n.Position;
        v.Unitize();
        nodeLines.Add(new Line(n.Position, v * jointSize));
      }
      nodes.Add(n.Position); // add the position of the current node to the new list of points
    }

    for(int ei = 0;ei < skeleton.HalfEdges.Count;ei += 2)
    {
      Line L = skeleton.HalfEdges[ei].GetLine();
      Vector3d v = skeleton.HalfEdges[ei].GetDirection(true);
      v *= jointSize;
      Line segment = new Line(L.From + v, L.To - v);
      strutLines.Add(segment);
    }

    Joints = nodeLines;
    Structs = strutLines;
    JointPts = nodes; // set the output to the new list of points
# ---------- c_script: C# additional code ----------
  /// <summary>
  /// This method will be called once every solution, before any calls to RunScript.
  /// </summary>
  public override void BeforeRunScript()
  { }
  /// <summary>
  /// This method will be called once every solution, after any calls to RunScript.
  /// </summary>
  public override void AfterRunScript()
  { }
# ---------- end c_script ----------
number_slider = Slider(6, range=0..10)  # disabled
short = ShortestList(ListA=c_script.JointPts, ListB=jointradius_2, TrimMode=2)  # -> ListA, ListB
end = EndPoints(Curve=c_script.Structs)  # -> Start, End; disabled
endoffset_2 = GetNumber(endoffset, {"0"}, selected=[], AtLeast=0, AtMost=1, Maximum=1.797693135e+308, Minimum=0, TreeAccess=False)
structsize_2 = GetNumber(structsize, {"1"}, selected=[], AtLeast=1, AtMost=1, Maximum=1.797693135e+308, Minimum=1, TreeAccess=False)
kinkangle = GetNumber(Slider(0, range=0..1), {"0"}, selected=[], AtLeast=0, AtMost=1, Maximum=1.797693135e+308, Minimum=0, TreeAccess=False)
caps_2 = GetNumber(caps, {"0"}, selected=[], AtLeast=0, AtMost=1, Maximum=2, Minimum=0, TreeAccess=False)
duppt = RemoveDuplicatePts(Points=[end.Start, end.End], Tolerance=0.01)  # disabled
cps = ClosestPoints(Point=c_script.JointPts, Cloud=duppt, Count=number_slider)  # -> ClosestPoint, CPIndex, Distance; disabled
smaller = SmallerThan(FirstNumber=cps.Distance, SecondNumber=expr("x*1.2", jointsize_2))  # -> SmallerThan, OrEqualTo; disabled
mp = MultiPipe(
    Curves=c_script.Joints,
    NodeSize=short.ListB,
    SizePoints=short.ListA,
    EndOffset=endoffset_2,
    StrutSize=structsize_2,
    Segment=0,
    KinkAngle=kinkangle,
    CubeFit=0,
    Caps=caps_2)
cull = CullPattern(List=cps.CPIndex, CullPattern=smaller.OrEqualTo)  # disabled
mesh = Mesh(mp)
crv_2 = Curve(c_script.Structs)
item = ListItem(List=c_script.Structs, Index=cull, Wrap=True)  # -> simplify(Item); disabled
cluster = Cluster(M=mesh)
panel = Panel("1")  # disabled
panel_2 = Panel("0")  # disabled
cluster_2 = Cluster(M=cluster)
number_slider_2 = Slider(5, range=0..10)  # disabled
eval = EvaluateCurve(Curve=reparameterize(item), Parameter=panel_2)  # -> Point, Tangent, Angle; disabled
eval_2 = EvaluateCurve(Curve=reparameterize(item), Parameter=panel)  # -> Point, Tangent, Angle; disabled
merge = Merge(Data1=eval.Point, Data2=eval_2.Point)  # disabled
disjoint = DisjointMesh(Mesh=cluster_2)
cps_2 = ClosestPoints(Point=simplify(graft(c_script.JointPts)), Cloud=merge, Count=number_slider)  # -> ClosestPoint, CPIndex, Distance; disabled
vec2pt = Vector2Pt(PointA=eval.Point, PointB=graft(c_script.JointPts), Unitize=False)  # -> Vector, Length; disabled
vec2pt_2 = Vector2Pt(PointA=eval_2.Point, PointB=graft(c_script.JointPts), Unitize=False)  # -> Vector, Length; disabled
context_bake = ContextBake(Geometry=crv_2)
context_bake_2 = ContextBake(Geometry=disjoint)
smaller_2 = SmallerThan(FirstNumber=cps_2.Distance, SecondNumber=expr("x*1.05", jointsize_2))  # -> SmallerThan, OrEqualTo; disabled
pl = PlaneNormal(Origin=eval_2.Point, ZAxis=simplify(eval_2.Tangent))  # disabled
pl_2 = PlaneNormal(Origin=eval.Point, ZAxis=simplify(eval.Tangent))  # disabled
dom = ConstructDomain(DomainStart=expr("-x", number_slider_2), DomainEnd=number_slider_2)  # disabled
cir = Circle(Plane=pl_2, Radius=number_slider_2)  # disabled
rectangle = Rectangle(Plane=pl_2, XSize=dom, YSize=dom, Radius=0)  # -> Rectangle, Length; disabled
rectangle_2 = Rectangle(Plane=pl, XSize=dom, YSize=dom, Radius=0)  # -> Rectangle, Length; disabled
cull_2 = CullPattern(List=cps_2.CPIndex, CullPattern=smaller_2.OrEqualTo)  # disabled
merge_2 = Merge(Data1=rectangle.Rectangle, Data2=rectangle_2.Rectangle)  # disabled
item_2 = ListItem(List=merge_2, Index=cull_2, Wrap=True)  # disabled
data = Data(item_2)  # disabled

# ==== cluster ShatterInt: Shatter multiple curves at their intersections
crv = ClusterInput()

crv_2 = Curve(reparameterize(flatten(crv)))
cx = CurveSelf(Curve=crv_2)  # -> Points, Params
shatter = Shatter(Curve=graft(crv_2), Parameters=cx.Params)
combine = CombineData(Input0=shatter, Input1=graft(crv_2))  # -> flatten(Result), Index

mcx = MultipleCurves(Curves=combine.Result)  # -> Points, IndexA, IndexB, ParamA, ParamB
cset = CreateSet(List=[mcx.IndexA, mcx.IndexB])  # -> Set, Map
lng = ListLength(List=combine.Result)
lng_2 = ListLength(List=[mcx.IndexA, mcx.IndexB])
series = Series(Start=0, Step=1, Count=lng)
series_2 = Series(Start=0, Step=1, Count=lng_2)
int = Integer(series)
path = CreatePath(Indices=graft(series_2))  # -> flatten(Branch)
exdiff = SetDifferenceS(SetA=cset.Set, SetB=int)
replace = ReplaceBranches(Data=simplify(graft([mcx.ParamA, mcx.ParamB])), Search=path, Replace=[mcx.IndexA, mcx.IndexB])
cull_i = CullIndex(List=combine.Result, Indices=exdiff, Wrap=False)
shatter_2 = Shatter(Curve=simplify(graft(cull_i)), Parameters=replace)

S = ClusterOutput(shatter_2)

# ==== cluster Cluster
M = ClusterInput()

wbcatmullclark = WeaverbirdsCatmullClarkSubdivision(MeshCurves=M, Level=1, SmoothNakedEdges=1)
demesh = DeconstructMesh(Mesh=wbcatmullclark)  # -> Vertices, Faces, Colours, Normals
wbnaked = WeaverbirdsNakedBoundary(MeshClosedPolylines=wbcatmullclark)
disc = Discontinuity(Curve=wbnaked, Level=1)  # -> Points, Parameters
fcircle = CircleFit(Points=disc.Points)  # -> Circle, Radius, Deviation
crv_cp = CurveClosestPoint(Point=disc.Points, Curve=fcircle.Circle)  # -> flatten(Point), Parameter, Distance
cp = ClosestPoint(Point=crv_cp.Point, Cloud=demesh.Vertices)  # -> ClosestPoint, CPIndex, Distance
replace = ReplaceItems(List=demesh.Vertices, Item=crv_cp.Point, Indices=cp.CPIndex, Wrap=False)
conmesh = ConstructMesh(Vertices=replace, Faces=demesh.Faces)

M_2 = ClusterOutput(conmesh)
